# Grasshopper definition circle-dot.gh (Grasshopper 1.0.7)
# plug-ins: Bifocals

point = Point(<point referenced from the Rhino model>)
number_slider = Slider(22, range=0..100)
xy_plane = XYPlane(Origin=point)
square = Square(Plane=xy_plane, Size=Slider(3.25, range=0..10), ExtentX=number_slider, ExtentY=number_slider)  # -> flatten(Cells), Points
area = Area(Geometry=square.Cells)  # -> Area, Centroid
point_2 = Point(area.Centroid)
pull_point = PullPoint(Point=point_2, Geometry=point, ClosestOnly=True)  # -> ClosestPoint, Distance
number_slider_2 = Slider(1.559, range=0..2.3)
xy_plane_2 = XYPlane(Origin=area.Centroid)
construct_domain = ConstructDomain(DomainStart=Slider(0.276, range=0..2.3), DomainEnd=Slider(2.3, range=0..2.3))
bounds = Bounds(Numbers=pull_point.Distance)
remap_numbers = RemapNumbers(Value=pull_point.Distance, Source=bounds, Target=construct_domain)  # -> Mapped, Clipped
circle = Circle(Plane=xy_plane_2, Radius=remap_numbers.Mapped)
