# Grasshopper definition 直线圆管.gh (Grasshopper 1.0.7)
# plug-ins: Bifocals

curve = Curve([<curve referenced from the Rhino model> x16])
pipe = Pipe(Curve=curve, Radius=Slider(1.8, range=0..10), Caps=Slider(1, range=0..1))
