# Grasshopper definition FAS.gh (Grasshopper 1.0.7)

geometry = Geometry(<brep referenced from the Rhino model>)
geometry_2 = Geometry(<brep referenced from the Rhino model>)
mesh_brep = MeshBrep(
    Brep=geometry_2,
    Settings={GridMaxCount=0, GridMinCount=16, JaggedSeams=False, MaxEdgeLength=0, MinEdgeLength=0.0001, MinTolerance=0, Refine=True, RefineAngle=0, RelativeTolerance=0.65, SimplePlanes=True, Tolerance=0})
bounding_box = BoundingBox(Content=geometry_2, Plane=PlaneXY(0, 0, 0), UnionBox=True)  # -> Box, Box_2
mesh_join = MeshJoin(Meshes=mesh_brep)
range = Range(Domain=Domain(0, 1), Steps=Slider(66, range=0..100))
range_2 = Range(Domain=Domain(0, 1), Steps=Slider(51, range=0..100))
deconstruct_box = DeconstructBox(Box=bounding_box.Box)  # -> Plane, X, Y, Z
shift_list = ShiftList(List=range_2, Shift=1, Wrap=False)
shift_list_2 = ShiftList(List=range, Shift=1, Wrap=False)
cull_index = CullIndex(List=range, Indices=Slider(0, range=0..100), Wrap=False)
deconstruct_domain = DeconstructDomain(Domain=deconstruct_box.X)  # -> Start, End
deconstruct_domain_2 = DeconstructDomain(Domain=deconstruct_box.Y)  # -> Start, End
construct_domain = ConstructDomain(DomainStart=range_2, DomainEnd=shift_list)
construct_domain_2 = ConstructDomain(DomainStart=range, DomainEnd=shift_list_2)
absolute = Absolute(Value=deconstruct_domain.Start)
absolute_2 = Absolute(Value=deconstruct_domain.End)
absolute_3 = Absolute(Value=deconstruct_domain_2.End)
absolute_4 = Absolute(Value=deconstruct_domain_2.Start)
addition = Addition(A=absolute_4, B=absolute_3)
addition_2 = Addition(A=absolute, B=absolute_2)
series = Series(Start=0, Step=addition_2, Count=Slider(10, range=0..10))
series_2 = Series(Start=0, Step=addition, Count=Slider(12, range=0..100))
surface_morph = SurfaceMorph(
    Geometry=mesh_join,
    Reference=bounding_box.Box,
    Surface=reparameterize(geometry),
    UDomain=construct_domain_2,
    VDomain=graft(construct_domain),
    WDomain=Slider(1, range=0..1))  # disabled
vector_xyz = VectorXYZ(XComponent=series, YComponent=graft(series_2), ZComponent=0)  # -> Vector, Length
move = Move(Geometry=mesh_join, Motion=vector_xyz.Vector)  # -> Geometry, Transform
number_slider = Slider(1, range=0..1)
bounding_box_2 = BoundingBox(Content=flatten(move.Geometry), Plane=PlaneXY(0, 0, 0), UnionBox=True)  # -> Box, Box_2
surface_morph_2 = SurfaceMorph(
    Geometry=move.Geometry,
    Reference=bounding_box_2.Box,
    Surface=reparameterize(geometry),
    UDomain=number_slider,
    VDomain=number_slider,
    WDomain=Slider(9, range=0..100))
