# Grasshopper definition Lello_triangle.gh (Grasshopper 1.0.7)
# plug-ins: Bifocals

plane = Plane(PlaneXY(0, 0, 0))
circle = Circle(Plane=plane, Radius=Slider(40, range=0..100))
divide_curve = DivideCurve(Curve=circle, Count=Slider(3, range=0..10), Kinks=False)  # -> Points, Tangents, Parameters
plane_2 = Plane(PlaneXY(0, 0, 0))
list_item = ListItem(List=divide_curve.Points, Index=Slider(1, range=0..1), Wrap=True)
list_item_2 = ListItem(List=divide_curve.Points, Index=Slider(0, range=0..100), Wrap=True)
line = Line(StartPoint=list_item_2, EndPoint=list_item)
length = Length(Curve=line)
circle_2 = Circle(Plane=divide_curve.Points, Radius=length)
point = Point(circle_2)
shatter = Shatter(Curve=circle_2, Parameters=point)
