# Grasshopper definition Surface_split_by_line.gh (Grasshopper 1.0.7)

surface = Surface()
curve = Curve()
surface_split = SurfaceSplit(Surface=surface, Curves=curve)
surface_2 = Surface(surface_split)
