# Grasshopper definition 表带直线打孔.gh (Grasshopper 1.0.7)
# plug-ins: Bifocals

curve = Curve([<curve referenced from the Rhino model> x18])
line = Line(curve)
end_points = EndPoints(Curve=line)  # -> Start, End
vector_2pt = Vector2Pt(PointA=end_points.Start, PointB=end_points.End, Unitize=Slider(1, range=0..1))  # -> Vector, Length
number_slider = Slider(5, range=0..10)
plane_normal = PlaneNormal(Origin=end_points.Start, ZAxis=vector_2pt.Vector)
integer_division = IntegerDivision(A=number_slider, B="2")
unit_x = UnitX(Factor=integer_division)
rectangle = Rectangle(Plane=plane_normal, XSize=Slider(2.1, range=0..10), YSize=number_slider, Radius=Slider(1.5, range=0..10))  # -> Rectangle, Length
area = Area(Geometry=rectangle.Rectangle)  # -> Area, Centroid
vector_2pt_2 = Vector2Pt(PointA=area.Centroid, PointB=end_points.Start, Unitize=False)  # -> Vector, Length
unit_vector = UnitVector(Vector=vector_2pt.Vector)
move = Move(Geometry=rectangle.Rectangle, Motion=vector_2pt_2.Vector)  # -> Geometry, Transform
multiplication = Multiplication(A=unit_vector, B=Slider(38, range=0..100))
extrude = Extrude(Base=move.Geometry, Direction=multiplication)
