# Grasshopper definition Hexagonal_devide.gh (Grasshopper 1.0.7)

surface = Surface(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)
brep_edges = BrepEdges(Brep=surface)  # -> Naked, Interior, NonManifold
list_item = ListItem(List=brep_edges.Naked, Index=0, Wrap=True)
end_points = EndPoints(Curve=list_item)  # -> Start, End
point = Point(end_points.Start)
number_slider = Slider(76, range=0..100)
yz_plane = YZPlane(Origin=point)
hexagonal = Hexagonal(Plane=yz_plane, Size=Slider(1.77, range=0..3), ExtentX=number_slider, ExtentY=number_slider)  # -> Cells, Points
scale = Scale(Geometry=hexagonal.Cells, Center=hexagonal.Points, Factor=Slider(0.92, range=0..1))  # -> Geometry, Transform
surface_split = SurfaceSplit(Surface=surface, Curves=flatten(scale.Geometry))
list_item_2 = ListItem(List=surface_split, Index=Slider(5210, range=0..5211), Wrap=True)
surface_2 = Surface(list_item_2)
