# Grasshopper definition Parametric_Facade_Design.gh (Grasshopper 1.0.7)
# plug-ins: LunchBox

surface = Surface(<surface referenced from the Rhino model>)
diamond_panels = DiamondPanels(Surface=surface, UDivisions=Slider(12, range=0..100), VDivisions=Slider(20, range=0..100))  # -> DiamondPanels, TriPanels
panel_frame = PanelFrame(Panel=diamond_panels.DiamondPanels, ScaleFactor=0.5)  # -> PanelFrame, Panel
unit_y = UnitY(Factor=Slider(16, range=0..100))
curve = Curve(graft(panel_frame.Panel))
curve_2 = Curve(graft(diamond_panels.DiamondPanels))
move = Move(Geometry=curve, Motion=unit_y)  # -> Geometry, Transform
area = Area(Geometry=move.Geometry)  # -> Area, Centroid
curve_3 = Curve(<curve referenced from the Rhino model>)
curve_closest_point = CurveClosestPoint(Point=area.Centroid, Curve=curve_3)  # -> Point, Parameter, Distance
flatten_tree = FlattenTree(Tree=curve_closest_point.Distance, Path="{0}")
construct_domain = ConstructDomain(DomainStart=Slider(0.31, range=0..1), DomainEnd=Slider(1.7, range=0..10))
bounds = Bounds(Numbers=flatten_tree)
remap_numbers = RemapNumbers(Value=curve_closest_point.Distance, Source=bounds, Target=construct_domain)  # -> Mapped, Clipped
scale = Scale(Geometry=move.Geometry, Center=area.Centroid, Factor=remap_numbers.Mapped)  # -> Geometry, Transform
loft = Loft(
    Curves=[scale.Geometry, curve_2],
    Options={Adjust=False, Closed=False, LoftEnds=0, LoftSimp=0, LoftType=0, Rebuild=10, Refit=0.01})
colour_rgb = ColourRGB(Alpha=255, Red=loft, Green=loft, Blue=loft)
custom_preview = CustomPreview(Geometry=loft, Material=colour_rgb)
