# Grasshopper definition brick.gh (Grasshopper 1.0.7)

number_slider = Slider(5, range=0..10)
number_slider_2 = Slider(20, range=0..100)
number_slider_3 = Slider(2, range=0..10)
xz_plane = XZPlane(Origin=Point(0, 0, 0))
rectangular = Rectangular(Plane=xz_plane, SizeX=number_slider, SizeY=number_slider_3, ExtentX=number_slider_2, ExtentY=number_slider_2)  # -> Cells, Points
polygon_center = PolygonCenter(Polyline=rectangular.Cells)  # -> CenterV, CenterE, CenterA
offset_curve = OffsetCurve(Curve=rectangular.Cells, Distance=expr("-x", Slider(0.1, range=0..1)), Plane=xz_plane, Corners=1)
shift_paths = ShiftPaths(Data=offset_curve, Offset=-1)
region_union = RegionUnion(Curves=flatten(rectangular.Cells))
box_rectangle = BoxRectangle(Rectangle=shift_paths, Height=number_slider_3)  # -> simplify(Box)
simplify_curve = SimplifyCurve(Curve=region_union)  # -> Curve, Simplified
division = Division(A=number_slider, B="2")
flip_matrix = FlipMatrix(Data=box_rectangle)
explode = Explode(Curve=simplify_curve.Curve, Recursive=True)  # -> Segments, Vertices
panel = Panel("""0
2""")
unit_x = UnitX(Factor=division)
split_tree = SplitTree(Data=flip_matrix, Masks=flatten("{0,2,...}"))  # -> Positive, Negative
list_item = ListItem(List=explode.Segments, Index=panel, Wrap=True)
move = Move(Geometry=split_tree.Negative, Motion=unit_x)  # -> Geometry, Transform
curve_middle = CurveMiddle(Curve=list_item)
merge = Merge(Data1=split_tree.Positive, Data2=move.Geometry)
polyline = PolyLine(Vertices=curve_middle, Closed=False)
evaluate_curve = EvaluateCurve(Curve=polyline, Parameter=Slider(0.433, range=0..1))  # -> Point, Tangent, Angle
value_list = ValueList({"Line": 0, "Point": 1}, selected="Point")
area = Area(Geometry=merge)  # -> Area, Centroid
stream_filter = StreamFilter(Gate=value_list, Stream0=polyline, Stream1=evaluate_curve.Point)
pull_point = PullPoint(Point=area.Centroid, Geometry=stream_filter, ClosestOnly=True)  # -> ClosestPoint, Distance
sort_list = SortList(Keys=flatten(pull_point.Distance))  # -> reverse(Keys), ValuesValuesA
negative = Negative(Value=Slider(0.25, range=0..0.25))
list_item_2 = ListItem(List=sort_list.Keys, Index=0, Wrap=True)
pi = Pi(Factor=negative)
multiplication = Multiplication(A=list_item_2, B=Slider(0.789, range=0..1))
minimum = Minimum(A=pull_point.Distance, B=multiplication)
xy_plane = XYPlane(Origin=area.Centroid)
construct_domain = ConstructDomain(DomainStart=pi, DomainEnd="0")
bounds = Bounds(Numbers=flatten(minimum))
remap_numbers = RemapNumbers(Value=minimum, Source=bounds, Target=construct_domain)  # -> Mapped, Clipped
rotate = Rotate(Geometry=merge, Angle=remap_numbers.Mapped, Plane=xy_plane)  # -> Geometry, Transform
brep = Brep(rotate.Geometry)
