# Grasshopper definition extrude_body.gh (Grasshopper 1.0.7)
# plug-ins: Bifocals

xz_plane = XZPlane(Origin="0,0,0")
rectangle_2pt = Rectangle2Pt(Plane=xz_plane, PointA="0,0,0", PointB="1220,0,3048", Radius=0)  # -> Rectangle, Length
unit_y = UnitY(Factor=Slider(1, range=0..1))
fragment_patch = FragmentPatch(Boundary=rectangle_2pt.Rectangle)
extrude = Extrude(Base=rectangle_2pt.Rectangle, Direction=unit_y)
surface = Surface(fragment_patch)
move = Move(Geometry=surface, Motion=unit_y)  # -> Geometry, Transform
brep_join = BrepJoin(Breps=[surface, extrude, move.Geometry])  # -> Breps, Closed
brep = Brep(brep_join.Breps)
