# Grasshopper definition 线段干扰.gh (Grasshopper 1.0.7)
# plug-ins: Bifocals

xy_plane = XYPlane(Origin=Point(0, 0, 0))
hexagonal = Hexagonal(Plane=xy_plane, Size=Slider(2, range=0..10), ExtentX=Slider(20, range=0..100), ExtentY=Slider(30, range=0..100))  # -> flatten(Cells), flatten(Points)
curve = Curve(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)
point = Point(hexagonal.Points)
number_slider = Slider(0, range=0..1)
pull_point = PullPoint(Point=point, Geometry=curve, ClosestOnly=True)  # -> ClosestPoint, Distance
construct_domain = ConstructDomain(DomainStart=Slider(0.07, range=0..1), DomainEnd=Slider(1, range=0..1))
bounds = Bounds(Numbers=pull_point.Distance)
remap_numbers = RemapNumbers(Value=pull_point.Distance, Source=bounds, Target=construct_domain)  # -> Mapped, Clipped
scale = Scale(Geometry=hexagonal.Cells, Center=point, Factor=remap_numbers.Mapped)  # -> Geometry, Transform
